# Grasshopper definition divisorplot.ghx (Grasshopper 0.6.57)

# olivier pasquet 2010
panel = Panel("1")
# divisor plot
series = Series(S=panel, N=1, C="10")
series_2 = Series(S="1", N=1, C="2")
product_curve = DotNETVBScript(n=series, l=series_2)  # -> out, go; inputs n: list, l: list
# ---------- product_curve: VB ----------
    Dim pointlist As New List(Of on3dpoint)
    Dim grandepointlist As New DataTree(Of On3dPoint)
    Dim ii As Integer
    Dim iii As Integer
    Dim ll As Integer
    Dim nn As Integer

    ll = l.Count
    nn = n.Count

    For iii = 0 To nn - 1
      Dim path As New GH_Path(iii)
      For ii = 0 To ll - 1
        Dim point1 As New On3dPoint
        Dim point2 As New On3dPoint
        point1.y = (n(iii) + 2 * l(ii)) / 2 + n(iii) / 2
        point2.y = (n(iii) + 2 * l(ii)) / 2 - n(iii) / 2
        point1.z = 0
        point2.z = 0
        point1.x = point1.y * point2.y
        point2.x = point1.y * point2.y
        grandepointlist.Add(point1, path)
        grandepointlist.Add(point2, path)

      Next
    Next
    go = grandepointlist
# ---------- end product_curve ----------
preview = CustomPreview(
    G=product_curve.go,
    S={diffuse=RGBA(154, 205, 50, 0), ambient=RGBA(0, 0, 0, 0), emission=RGBA(77, 102, 25, 0), specular=RGBA(255, 255, 255, 0), reflect=RGBA(255, 255, 255, 0), refract=RGBA(255, 255, 255, 0), shine=25.5, ior=1, transparency=0, reflectivity=0})
