# Grasshopper definition numberspiral.ghx (Grasshopper 0.6.57)

# olivier pasquet 2010
panel = Panel("100")
# cartesian number spiral
cartspiral = DotNETVBScript(items=panel)  # -> out, A
# ---------- cartspiral: VB ----------
    Dim x As Integer = 0
    Dim y As Integer = 0
    Dim min_x As Integer = 0
    Dim max_x As Integer = 0
    Dim min_y As Integer = 0
    Dim max_y As Integer = 0
    Dim dir As Integer = 0
    Dim value As Integer = 0
    Dim dirlo As Integer = 0

    Dim pointlist As New List(Of On3dPoint)

    pointlist.Add(New On3dPoint(x, y, 0))
    
    For i As Integer = 0 To items - 1
      Dim add_x As Integer
      Dim add_y As Integer

      value = value + 1
      add_x = direction(dirlo)(0)
      add_y = direction(dirlo)(1)
      x = x + add_x
      y = y + add_y

      If x < min_x Then
        dirlo = (dirlo + 1) Mod 4
        min_x = x
      Else If x > max_x Then
        dirlo = (dirlo + 1) Mod 4
        max_x = x
      Else If y < min_y Then
        dirlo = (dirlo + 1) Mod 4
        min_y = y
      Else If  y > max_y Then
        dirlo = (dirlo + 1) Mod 4
        max_y = y
      End If

      pointlist.Add(New On3dPoint(x, y, 0))

    Next

    A = pointlist
# ---------- cartspiral: VB additional code ----------
  Private Function direction(n As Integer) As Integer()

    Dim direct(2) As Integer
    If n = 0 Then
      direct(0) = 0
      direct(1) = -1
    ElseIf n = 1 Then
      direct(0) = -1
      direct(1) = 0
    ElseIf n = 2 Then
      direct(0) = 0
      direct(1) = 1
    ElseIf n = 3 Then
      direct(0) = 1
      direct(1) = 0
    End If
    direction = direct
  End Function
# ---------- end cartspiral ----------
preview = CustomPreview(
    G=cartspiral.A,
    S={diffuse=RGBA(154, 205, 50, 0), ambient=RGBA(0, 0, 0, 0), emission=RGBA(77, 102, 25, 0), specular=RGBA(255, 255, 255, 0), reflect=RGBA(255, 255, 255, 0), refract=RGBA(255, 255, 255, 0), shine=25.5, ior=1, transparency=0, reflectivity=0})
panel_2 = Panel(cartspiral.A)
# polar number spiral
pol_spiral = DotNETVBScript(items="100")  # -> out, A
# ---------- pol_spiral: VB ----------
    Dim x As Integer = 0
    Dim y As Integer = 0
    Dim temp As Double
    Dim pointlist As New List(Of On3dPoint)

    Dim PI As Double
    PI = 4 * Math.Atan(1)

    For i As Integer = 0 To items - 1
      temp = Math.Sqrt(i)
      pointlist.Add(New On3dPoint(temp * Math.Cos(2 * PI * temp), -1 * temp * Math.Sin(2 * PI * temp), 0))
    Next

    A = pointlist
# ---------- end pol_spiral ----------
preview_2 = CustomPreview(
    G=pol_spiral.A,
    S={diffuse=RGBA(154, 205, 50, 0), ambient=RGBA(0, 0, 0, 0), emission=RGBA(77, 102, 25, 0), specular=RGBA(255, 255, 255, 0), reflect=RGBA(255, 255, 255, 0), refract=RGBA(255, 255, 255, 0), shine=25.5, ior=1, transparency=0, reflectivity=0})
panel_3 = Panel(pol_spiral.A)
