# Grasshopper definition primegenerator.ghx (Grasshopper 0.6.57)

# olivier pasquet 2010
panel = Panel("1")
# prime numbers generator
panel_2 = Panel("100")
prime = DotNETVBScript(lowerLimit=panel, upperLimit=panel_2)  # -> out, A
# ---------- prime: VB ----------
    Dim primeNumber As Integer
    Dim isPrime As Boolean = False
    Dim result As arrayList = New arrayList()


    While lowerLimit < upperLimit

      primeNumber = lowerLimit

      If primeNumber = 2 Or primeNumber = 3 Then
        isPrime = True
      ElseIf primeNumber = 1 Then
        isPrime = False
      ElseIf primeNumber = upperLimit Then
        Exit While
      Else
        For i As Integer = 2 To (primeNumber - 1)
          If primeNumber Mod i = 0 Then
            isPrime = False
            Exit For
          Else
            isPrime = True
          End If
        Next
      End If

      If isPrime = True Then
        result.Add(primeNumber)
      End If

      lowerLimit += 1
    End While

    A = result
# ---------- end prime ----------
panel_3 = Panel(prime.A)
